# Dynamo graph Home.dyn (Dynamo 2.10.0.3455)

code_block = CodeBlock()
# ---------- code_block.designscript (14 lines) ----------
Object Design:

FirstFace(face)
	updatedFace(face)

face
properties
	edges(edge)

edge

edgetype
	Inner
	Outer;
# ----------------------------------------
python_script = Python()  # IronPython2; starter script, not edited (OUT = 0)
