# Dynamo graph Test.dyn (Dynamo 2.12.1.8246)
# packages: SpeckleDynamo2 2.0.0, MeshToolkit 3.0.0, spring nodes 210.1.1

select_model_elements = DSModelElementsSelection()  # 46 picked in the model
geometry = Element.Geometry(element=select_model_elements)
flatten = List.Flatten(list=geometry)
byGeometry = Autodesk.Dynamo.MeshToolkit.Mesh.ByGeometry(inputGeometry=flatten)
ꟿ_tkmesh_tomesh = Custom[ꟿ TkMesh.ToMesh](tkMesh=byGeometry)  # package spring nodes; Attempts to convert a toolkit mesh to a Dynamo mesh. You obviously need to have the appropriate version of the mesh toolkit package downloaded first.
code_block = CodeBlock { "https://speckle.xyz/streams/547b147012"; }
send = Send(data=ꟿ_tkmesh_tomesh, stream=code_block, AutoUpdate=true)
create_stream = CreateStream(CreateEnabled=true)
brick = Speckle.ConnectorDynamo.Functions.AAA.ASpeckleBrick.Brick()
code_block_2 = CodeBlock { 2000; }
byLengths = Cuboid.ByLengths(width=code_block_2, length=code_block_2, height=code_block_2)
